# Dynamo graph script.dyn (Dynamo 2.6.1.8786)
# packages: Data-Shapes 2022.2.105, Clockwork for Dynamo 2.x 2.4.0, Genius Loci 2023.2.21, MEPover 2022.10.30

# group: Select Categorie & Family
code_block = CodeBlock { "Select Categorie"; }
file_path = Filename("..\..\ShareFolder\icon.png")
code_block_2 = CodeBlock { "Next"; }
code_block_3 = CodeBlock { "Categories:"; }
categories_list = Custom[Categories list]()  # package Data-Shapes; Gives list of all Revit categories and a matching list of their names
dropdown_data = Custom[DropDown Data](InputName=code_block_3, Keys=categories_list.Category_name_s, Values=categories_list.Category_name_s)  # package Data-Shapes; Create data for DropDown input in UI.MultiInputForm ++ . Check out www.data-shapes.net for more infos.
boolean = BoolSelector(true)
code_block_4 = CodeBlock { "https://github.com/CrossArchitecture"; }
code_block_5 = CodeBlock { "Cancel"; }
multipleinputform = Custom[MultipleInputForm ++](Description_optional=code_block, Logo_optional=file_path, ButtonText_optional=code_block_2, Inputs=dropdown_data, Toggle=boolean, LinkToHelp_optional=code_block_4, CancelButtonText_optional=code_block_5)  # package Data-Shapes; Create a form with multiple inputs. see www.data-shapes.net for tutorials and infos!
byName = Category.ByName(name=multipleinputform.User_Inputs)
code_block_6 = CodeBlock { "Select Families"; }
file_path_2 = Filename("..\..\ShareFolder\icon.png")
code_block_7 = CodeBlock { "Next"; }
code_block_8 = CodeBlock { "Families:"; }
passthrough = Custom[Passthrough](passThrough=byName, waitFor=multipleinputform.Was_Run)  # package Clockwork for Dynamo 2.x; Forces a sequential order of execution. The node wired into the output of the Passthrough node will be executed *after* the node wired into the waitFor input (e.g. important for some Revit operations). The value of the passThrough input will be passed on to the node wired into the output port of the Passthrough node.
all_family_types_of_category = Custom[All Family Types Of Category](category=passthrough)  # package Clockwork for Dynamo 2.x; Gets all family types/symbols of a given category in the model.
listview_data = Custom[Listview Data](InputName=code_block_8, Keys=all_family_types_of_category@L2, Values=all_family_types_of_category@L2)  # package Data-Shapes; Create data for ListView input in UI.MultiInputForm ++ . Check out www.data-shapes.net for more infos.
boolean_2 = BoolSelector(true)
code_block_9 = CodeBlock { "https://github.com/CrossArchitecture"; }
code_block_10 = CodeBlock { "Cancel"; }
multipleinputform_2 = Custom[MultipleInputForm ++](Description_optional=code_block_6, Logo_optional=file_path_2, ButtonText_optional=code_block_7, Inputs=listview_data, Toggle=boolean_2, LinkToHelp_optional=code_block_9, CancelButtonText_optional=code_block_10)
passthrough_2 = Custom[Passthrough](passThrough=multipleinputform_2.User_Inputs, waitFor=multipleinputform_2.Was_Run)

# group: Input and Filter
all_elements_of_category = ElementsOfCategory(Category=byName)
getFamily = FamilyInstance.GetFamily(familyInstance=all_elements_of_category)
flatten = List.Flatten(list=passthrough_2)
family = FamilyType.Family(familyType=flatten)
name = Family.Name(family=family)
all_elements_of_family = Custom[All Elements of Family](family=family)  # package Genius Loci; Get the family instances of the given loadable family.
flatten_2 = List.Flatten(list=all_elements_of_family)
watch = Watch(flatten_2)

flatten_3 = List.Flatten(list=getFamily)
name_2 = Family.Name(family=flatten_3)
contains = String.Contains(str=name_2, searchFor=name, lacing=CrossProduct)
anyTrue = Custom[Booleans.AnyTrue](seq=contains)  # package Clockwork for Dynamo 2.x; Returns true if any item in a list of booleans is true.

# group (continued): Input and Filter
filterByBoolMask = List.FilterByBoolMask(list=name_2, mask=anyTrue)
watch_2 = Watch(filterByBoolMask.in)

# group: Pie Chart
code_block_11 = CodeBlock { "FYI | Pie Chart"; }
file_path_3 = Filename("..\..\ShareFolder\icon.png")
code_block_12 = CodeBlock { "Next"; }
code_block_13 = CodeBlock { "Your Selection:"; }
passthrough_3 = Custom[Passthrough](passThrough=watch_2, waitFor=watch_2)
countOccurences = Custom[List.CountOccurences](seq=passthrough_3)  # package Clockwork for Dynamo 2.x; Counts the number of occurences of each unique element in a given list
pieChart = Custom[PieChart](Chart_name=code_block_13, series=countOccurences.uniqueElements, values=countOccurences.count)  # package Data-Shapes; PieChart
boolean_3 = BoolSelector(true)
code_block_14 = CodeBlock { "https://github.com/CrossArchitecture"; }
code_block_15 = CodeBlock { "Cancel"; }
code_block_16 = CodeBlock { 600; }
multipleinputform_3 = Custom[MultipleInputForm ++](Description_optional=code_block_11, Logo_optional=file_path_3, ButtonText_optional=code_block_12, Inputs=pieChart, Toggle=boolean_3, LinkToHelp_optional=code_block_14, CancelButtonText_optional=code_block_15, Width_optional=code_block_16)

# group: Select Family Parameter
code_block_17 = CodeBlock { "Select Family Parameter"; }
file_path_4 = Filename("..\..\ShareFolder\icon.png")
code_block_18 = CodeBlock { "Add Parameter"; }
code_block_19 = CodeBlock { "Family Parameter:"; }
firstItem = List.FirstItem(list=watch)
parameters = Element.Parameters(element=firstItem)
name_3 = Parameter.Name(parameter=parameters)
listview_data_2 = Custom[Listview Data](InputName=code_block_19, Keys=name_3, Values=name_3)
boolean_4 = BoolSelector(true)
code_block_20 = CodeBlock { "https://github.com/CrossArchitecture"; }
code_block_21 = CodeBlock { "Cancel"; }
code_block_22 = CodeBlock { 600; }
multipleinputform_4 = Custom[MultipleInputForm ++](Description_optional=code_block_17, Logo_optional=file_path_4, ButtonText_optional=code_block_18, Inputs=listview_data_2, Toggle=boolean_4, LinkToHelp_optional=code_block_20, CancelButtonText_optional=code_block_21, Width_optional=code_block_22)

# group: Include additional Information?
code_block_23 = CodeBlock { "Include additional Information?"; }
file_path_5 = Filename("..\..\ShareFolder\icon.png")
code_block_24 = CodeBlock { "Next"; }
code_block_25 = CodeBlock { "First Option"; }
code_block_26 = CodeBlock { "Hosting Element"; }
textnote_data = Custom[TextNote Data](TextNote=code_block_26)  # package Data-Shapes; Create Data for TextNote input in UI.MultipleInputForm ++ . Check out www.data-shapes.net for more informations
code_block_27 = CodeBlock { "Include hosting Element to Excel Table?"; }
boolean_input = Custom[Boolean input](InputName=code_block_27)  # package Data-Shapes; Creates a boolean input for UI.MultipleInputForm ++ . Check out www.data-shapes.net for more infos!
list_create = List.Create(item0=textnote_data, item1=boolean_input)
inputgroup_data = Custom[InputGroup Data](GroupTitle=code_block_25, Inputs=list_create)  # package Data-Shapes; Creates a group of inputs for UI.MultipleInputForm ++ . Check out www.data-shapes.net for more infos !
code_block_28 = CodeBlock { "Second Option"; }
code_block_29 = CodeBlock { "Unique Element ID"; }
textnote_data_2 = Custom[TextNote Data](TextNote=code_block_29)
code_block_30 = CodeBlock { "Include Element ID to Excel Table?"; }
boolean_input_2 = Custom[Boolean input](InputName=code_block_30)
list_create_2 = List.Create(item0=textnote_data_2, item1=boolean_input_2)
inputgroup_data_2 = Custom[InputGroup Data](GroupTitle=code_block_28, Inputs=list_create_2)
list_create_3 = List.Create(item0=inputgroup_data, item1=inputgroup_data_2)
passthrough_4 = Custom[Passthrough](passThrough=list_create_3, waitFor=multipleinputform_4.Was_Run)
boolean_5 = BoolSelector(true)
code_block_31 = CodeBlock { "https://github.com/CrossArchitecture"; }
code_block_32 = CodeBlock { "Cancel"; }
code_block_33 = CodeBlock { 600; }
multipleinputform_5 = Custom[MultipleInputForm ++](Description_optional=code_block_23, Logo_optional=file_path_5, ButtonText_optional=code_block_24, Inputs=passthrough_4, Toggle=boolean_5, LinkToHelp_optional=code_block_31, CancelButtonText_optional=code_block_32, Width_optional=code_block_33)
firstItem_2 = List.FirstItem(list=multipleinputform_5.User_Inputs)
filterByBoolMask_2 = List.FilterByBoolMask(list=code_block_26, mask=firstItem_2, lacing=CrossProduct)
lastItem = List.LastItem(list=multipleinputform_5.User_Inputs)
filterByBoolMask_3 = List.FilterByBoolMask(list=code_block_29, mask=lastItem, lacing=CrossProduct)
join = List.Join(list0=filterByBoolMask_2.in, list1=filterByBoolMask_3.in)

passthrough_5 = Custom[Passthrough](passThrough=multipleinputform_4.User_Inputs, waitFor=multipleinputform_5.User_Inputs)

# group (continued): Include additional Information?
flatten_4 = List.Flatten(list=passthrough_5)
join_2 = List.Join(list0=flatten_4, list1=join)
passthrough_6 = Custom[Passthrough](passThrough=join_2, waitFor=join_2)

# group: Reorder selected parameters if necessary
code_block_34 = CodeBlock { "Do you want to change the order?"; }
file_path_6 = Filename("..\..\ShareFolder\icon.png")
code_block_35 = CodeBlock { "Yes"; }
code_block_36 = CodeBlock { "Your current order!"; }
flatten_5 = List.Flatten(list=passthrough_6)
textnote_data_3 = Custom[TextNote Data](TextNote=flatten_5)
flatten_6 = List.Flatten(list=textnote_data_3)
code_block_37 = CodeBlock { 0; }
count = List.Count(list=flatten_5)
code_block_38 = CodeBlock { 1; }
sub = count - code_block_38
slider = Custom[Slider](Minimum=code_block_37, Maximum=sub)  # package Data-Shapes; Creates slider input for UI.MultipleInputForm ++ . Set the step to decimal value if you want a double slider, or to a integer value if you want an integer slider.
ofRepeatedItem = List.OfRepeatedItem(item=slider, amount=count)
zip_funktion = Python(IN[0]=flatten_6, IN[1]=ofRepeatedItem)
# ---------- zip_funktion.python (26 lines) ----------
# Load the Python Standard and DesignScript Libraries
import sys
import clr
clr.AddReference('ProtoGeometry')
from Autodesk.DesignScript.Geometry import *

# The inputs to this node will be stored as a list in the IN variables.
dataEnteringNode = IN

# Extrahiere die Eingangslisten L1 und L2
L1 = IN[0]
L2 = IN[1]

# Erstelle eine leere Liste für die neue Liste
nL = []

# Verwende eine For Each-Schleife, um die Elemente paarweise zu kombinieren
for i, (elem1, elem2) in enumerate(zip(L1, L2)):
    # Füge die kombinierten Elemente zur neuen Liste hinzu
    nL.append(elem1)
    nL.append(elem2)

# Das Ergebnis ist die neue Liste nL

# Weise den Wert der Ausgabevariablen OUT zu
OUT = nL
# ----------------------------------------
inputgroup_data_3 = Custom[InputGroup Data](GroupTitle=code_block_36, Inputs=zip_funktion)
boolean_6 = BoolSelector(true)
code_block_39 = CodeBlock { "https://github.com/CrossArchitecture"; }
code_block_40 = CodeBlock { "No"; }
code_block_41 = CodeBlock { 600; }
multipleinputform_6 = Custom[MultipleInputForm ++](Description_optional=code_block_34, Logo_optional=file_path_6, ButtonText_optional=code_block_35, Inputs=inputgroup_data_3, Toggle=boolean_6, LinkToHelp_optional=code_block_39, CancelButtonText_optional=code_block_40, Width_optional=code_block_41)
sortByKey = List.SortByKey(list=flatten_5, keys=multipleinputform_6.User_Inputs)
if_ = If(test=multipleinputform_6.Was_Cancelled, true=flatten_5, false=sortByKey.sorted_list)
flatten_7 = List.Flatten(list=if_)

# group: Change Parameter Name visible in Excel
code_block_42 = CodeBlock { "Do you want to change the Name?"; }
file_path_7 = Filename("..\..\ShareFolder\icon.png")
code_block_43 = CodeBlock { "Yes"; }
code_block_44 = CodeBlock { "Parameter Names"; }
textnote_data_4 = Custom[TextNote Data](TextNote=flatten_7)
flatten_8 = List.Flatten(list=textnote_data_4)
textbox_data = Custom[TextBox Data]()  # package Data-Shapes; Create Data for TextBox input in UI.MultipleInputForm ++ . Check out www.data-shapes.net for more informations
count_2 = List.Count(list=textnote_data_4)
cycle = List.Cycle(list=textbox_data, amount=count_2)
zip_funktion_2 = Python(IN[0]=flatten_8, IN[1]=cycle)  # same code as zip_funktion
inputgroup_data_4 = Custom[InputGroup Data](GroupTitle=code_block_44, Inputs=zip_funktion_2)
boolean_7 = BoolSelector(true)
code_block_45 = CodeBlock { "https://github.com/CrossArchitecture"; }
code_block_46 = CodeBlock { "No"; }
code_block_47 = CodeBlock { 600; }
multipleinputform_7 = Custom[MultipleInputForm ++](Description_optional=code_block_42, Logo_optional=file_path_7, ButtonText_optional=code_block_43, Inputs=inputgroup_data_4, Toggle=boolean_7, LinkToHelp_optional=code_block_45, CancelButtonText_optional=code_block_46, Width_optional=code_block_47)
if_2 = If(test=multipleinputform_7.Was_Cancelled, true=flatten_7, false=multipleinputform_7.User_Inputs)
header = Watch(if_2)

# group: Control
firstItem_3 = List.FirstItem(list=flatten_7)
getParameterValueByName = Element.GetParameterValueByName(parameterName=firstItem_3)  # unwired: element
sortByFunction = List.SortByFunction(list=watch, func=getParameterValueByName)
getParameterValueByName_2 = Element.GetParameterValueByName(element=sortByFunction, parameterName=firstItem_3)
groupByKey = List.GroupByKey(list=sortByFunction, keys=getParameterValueByName_2)
flatten_9 = List.Flatten(list=groupByKey.groups)
getParameterAsValueString = Custom[GetParameterAsValueString](flatten_9, ParameterName=flatten_7)  # package MEPover; Returns the parameter values without conversion to the revit internal unit system. The suffix boolean toggles the project units on or off
string_from_object = FromObject(obj=getParameterAsValueString)
code_block_48 = CodeBlock { ","; "."; }
replace = String.Replace(str=string_from_object, searchFor=code_block_48.out0, replaceWith=code_block_48.out1)
indexOf = List.IndexOf(list=flatten_7, element=code_block_26)
indexOf_2 = List.IndexOf(list=flatten_7, element=code_block_29)
list_create_4 = List.Create(item0=indexOf, item1=indexOf_2)
firstItem_4 = List.FirstItem(list=list_create_4)
firstItem_5 = List.FirstItem(list=multipleinputform_5.User_Inputs)
filterByBoolMask_4 = List.FilterByBoolMask(list=flatten_9, mask=firstItem_5, lacing=CrossProduct)
flatten_10 = List.Flatten(list=filterByBoolMask_4.in)
getHost = FamilyInstance.GetHost(familyInstance=flatten_10)
name_4 = ElementType.Name(elementType=getHost)
flatten_11 = List.Flatten(list=name_4)
lastItem_2 = List.LastItem(list=multipleinputform_5.User_Inputs)
filterByBoolMask_5 = List.FilterByBoolMask(list=flatten_9, mask=lastItem_2, lacing=CrossProduct)
flatten_12 = List.Flatten(list=filterByBoolMask_5.in)
id = Element.Id(element=flatten_12)
list_create_5 = List.Create(item0=flatten_11, item1=id)
firstItem_6 = List.FirstItem(list=list_create_5)
replaceItemAtIndex = List.ReplaceItemAtIndex(list=replace, index=firstItem_4, item=firstItem_6)
lastItem_3 = List.LastItem(list=list_create_4)
lastItem_4 = List.LastItem(list=list_create_5)
replaceItemAtIndex_2 = List.ReplaceItemAtIndex(list=replaceItemAtIndex, index=lastItem_3, item=lastItem_4)
transpose = List.Transpose(lists=replaceItemAtIndex_2)
data = Watch(transpose)

code_block_49 = CodeBlock { "Excel Export"; }

# group: Show and Export the Excel Table
code_block_50 = CodeBlock { "Preview Excel File"; }
file_path_8 = Filename("..\..\ShareFolder\icon.png")
code_block_51 = CodeBlock { "Next"; }
code_block_52 = CodeBlock { "Preview Excel File"; }
addItemToFront = List.AddItemToFront(item=header, list=data)
boolean_8 = BoolSelector(true)
datatable_input = Custom[DataTable input](InputName=code_block_52, Data=addItemToFront, FirstRowIsTitles=boolean_8, ShowTitleAndFileInfoInExport=boolean_8, OpenExcelAtExport=boolean_8)  # package Data-Shapes; Create a DataTable view input for UI.MultipleInputForm ++
code_block_53 = CodeBlock { "Create a Excel File, if the 'Export Button' dosn't work"; }
boolean_9 = BoolSelector(true)
code_block_54 = CodeBlock { "https://github.com/CrossArchitecture"; }
code_block_55 = CodeBlock { "Cancel"; }
code_block_56 = CodeBlock { 1500; }
code_block_57 = CodeBlock { 0; }
boolean_10 = BoolSelector(true)

filepath_data = Custom[FilePath Data](ButtonText=code_block_53)  # package Data-Shapes; Create filepath input for UI.MultipleInputForm ++ . Check out www.data-shapes.net for more infos !
list_create_6 = List.Create(item0=datatable_input, item1=filepath_data)

# group (continued): Show and Export the Excel Table
multipleinputform_8 = Custom[MultipleInputForm ++](Description_optional=code_block_50, Logo_optional=file_path_8, ButtonText_optional=code_block_51, Inputs=list_create_6, Toggle=boolean_9, LinkToHelp_optional=code_block_54, CancelButtonText_optional=code_block_55, MaxHeight_optional=code_block_56, Width_optional=code_block_56)
lastItem_5 = List.LastItem(list=multipleinputform_8.User_Inputs)
firstItem_7 = List.FirstItem(list=multipleinputform_8.User_Inputs)
exportExcel = Data.ExportExcel(filePath=lastItem_5, sheetName=code_block_49, startRow=code_block_57, startCol=code_block_57, data=firstItem_7, overWrite=boolean_10)
