# Dynamo graph script.dyn (Dynamo 2.6.1.8786)
# packages: Crumple 2022.5.27, archi-lab.net 2022.212.2722, spring nodes 210.1.1, Clockwork for Dynamo 2.x 2.3.0, Data-Shapes 2022.2.105, archi-lab.net 2023.213.1722, Genius Loci 2023.2.21, Clockwork for Dynamo 2.x 2.4.0

select_face_s_where_beam_s = SelectFaces()  # "Select Face(s) where beam(s) should be placed"; 2 picked in the model; graph input
what_does_this_script_do = StringInput("What does this script do?")
what_does_this_script_do_2 = StringInput("""With this script you can place beams on the centre line of a rectangular surfaces.
The script takes the selected surface, finds the two shortest edges and draws a line from the centre of these edges. This line is used to create a beam by a curve. """)
ui_messenger = Custom[© UI.Messenger](title=what_does_this_script_do, body=what_does_this_script_do_2, pass=select_face_s_where_beam_s)  # frozen; package Crumple; Displays a message box with a title/body and OK/cancel button. If OK is selected, the third input's data will be passed through.
passThrough = Custom[PassThrough](passThrough=select_face_s_where_beam_s, waitFor=ui_messenger)  # package archi-lab.net; Ripped this off from Clockwork. Sorry Andy.
family_types = FamilyTypes("Holz Träger - rechteckig:Holz 80 x 120")  # graph input
string = StringInput("Which beam do you want to use?")
boolean = BoolSelector(false)
ꟿ_list_dropdown = Custom[ꟿ List.DropDown](list=family_types, customMsg=string, reset=boolean)  # frozen; package spring nodes; Selects one list item by a drop-down combo box. The optional names input will override the object representation.
code_block = CodeBlock { "Beams through input Surface"; }
file_path = Filename("..\..\ShareFolder\icon.png")
code_block_2 = CodeBlock { "Next"; }
code_block_3 = CodeBlock { "Select Workset"; }
getAll = archilab.Revit.Elements.Workset.GetAll()
name = archilab.Revit.Elements.Workset.Name(workset=getAll)
workset_byname = Custom[Workset ByName](WorksetName=name)  # package Genius Loci; Retrieves the workset by the given name.
dropdown_data = Custom[DropDown Data](InputName=code_block_3, Keys=name, Values=workset_byname.Workset)  # package Data-Shapes; Create data for DropDown input in UI.MultiInputForm ++ . Check out www.data-shapes.net for more infos.
code_block_4 = CodeBlock { "Select Level"; }
categories = Categories("OST_Levels")
byCategory = archilab.Revit.Selection.Select.ByCategory(category=categories)
name_2 = Element.Name(element=byCategory)
getLevelByName = archilab.Revit.Selection.Select.GetLevelByName(name=name_2)
name_3 = Level.Name(level=getLevelByName)
dropdown_data_2 = Custom[DropDown Data](InputName=code_block_4, Keys=name_3, Values=getLevelByName)
code_block_5 = CodeBlock { "Select Beam"; }
categories_2 = Categories("OST_StructuralFraming")
all_family_types_of_category = Custom[All Family Types Of Category](category=categories_2)  # package Clockwork for Dynamo 2.x; Gets all family types/symbols of a given category in the model.
dropdown_data_3 = Custom[DropDown Data](InputName=code_block_5, Keys=all_family_types_of_category, Values=all_family_types_of_category)
list_create = List.Create(item0=dropdown_data, item1=dropdown_data_2, item2=dropdown_data_3)
inputgroup_data = Custom[InputGroup Data](Inputs=list_create)  # package Data-Shapes; Creates a group of inputs for UI.MultipleInputForm ++ . Check out www.data-shapes.net for more infos !
code_block_6 = CodeBlock { "Select Faces"; }
selectfaces_data = Custom[SelectFaces Data](ButtonText=code_block_6)  # package Data-Shapes; Creates a Revit face selection input for UI.MultipleInputForm++. Check out www.data-shapes.net for more infos!
inputgroup_data_2 = Custom[InputGroup Data](Inputs=selectfaces_data)
list_create_2 = List.Create(item0=inputgroup_data, item1=inputgroup_data_2)
boolean_2 = BoolSelector(true)
code_block_7 = CodeBlock { "https://github.com/CrossArchitecture"; }
code_block_8 = CodeBlock { "Cancel"; }
multipleinputform = Custom[MultipleInputForm ++](Description_optional=code_block, Logo_optional=file_path, ButtonText_optional=code_block_2, Inputs=list_create_2, Toggle=boolean_2, LinkToHelp_optional=code_block_7, CancelButtonText_optional=code_block_8)  # package Data-Shapes; Create a form with multiple inputs. see www.data-shapes.net for tutorials and infos!
perimeterCurves = Surface.PerimeterCurves(surface=multipleinputform.User_Inputs)
length = Curve.Length(curve=perimeterCurves)
sortByKey = List.SortByKey(list=perimeterCurves@L2, keys=length@L2, lacing=Shortest)
code_block_9 = CodeBlock { 0; 1; }
getItemAtIndex = List.GetItemAtIndex(list=sortByKey.sorted_list@L2, index=code_block_9.out0)
code_block_10 = CodeBlock { 0.5; }
pointAtParameter = Curve.PointAtParameter(curve=getItemAtIndex, param=code_block_10)
getItemAtIndex_2 = List.GetItemAtIndex(list=sortByKey.sorted_list@L2, index=code_block_9.out1)
pointAtParameter_2 = Curve.PointAtParameter(curve=getItemAtIndex_2, param=code_block_10)
byStartPointEndPoint = Line.ByStartPointEndPoint(startPoint=pointAtParameter, endPoint=pointAtParameter_2)
levels = Levels("06_DA_UKRD")  # graph input
beamByCurve = StructuralFraming.BeamByCurve(curve=byStartPointEndPoint, level=levels, structuralFramingType=family_types)  # graph output
passthrough = Custom[Passthrough](passThrough=multipleinputform.User_Inputs, waitFor=beamByCurve)  # package Clockwork for Dynamo 2.x; Forces a sequential order of execution. The node wired into the output of the Passthrough node will be executed *after* the node wired into the waitFor input (e.g. important for some Revit operations). The value of the passThrough input will be passed on to the node wired into the output port of the Passthrough node.
fromDynamoSurface = Custom[Element.FromDynamoSurface](DynamoSurface=passthrough)  # package Clockwork for Dynamo 2.x; Returns the underlying Revit element of a given face
delete = Element.Delete(element=fromDynamoSurface)
all_elements_of_category = ElementsOfCategory()  # unwired: Category
categories_3 = Categories()  # nothing selected
worksets = WorksetUi()  # nothing selected
name_4 = Family.Name(family=all_family_types_of_category)
