# Dynamo graph script.dyn (Dynamo 2.6.1.8786)
# packages: Genius Loci 2022.6.16, Crumple 2022.5.27, archi-lab.net 2023.213.1523, Clockwork for Dynamo 2.x 2.4.0, Data-Shapes 2022.2.103

# group: Get All Views, Schedules, Legends
collector_of_views = Custom[Collector of Views]()  # package Genius Loci; Collects all views in the active or given document.

# group: Filter by Dependancy
views_dependents = Custom[© Views.Dependents](views=collector_of_views.Without_Sheet_All_Views)  # package Crumple; For a view, returns any dependent views it has as well as whether it has any.
filterByBoolMask = List.FilterByBoolMask(list=collector_of_views.Without_Sheet_All_Views, mask=views_dependents.hasDependents)

# group: Get All Primary Views with Unplaced Dependant Views
isOnSheet = archilab.Revit.Views.Views.IsOnSheet(view=filterByBoolMask.in)
filterByBoolMask_2 = List.FilterByBoolMask(list=filterByBoolMask.in, mask=isOnSheet)
views_dependents_2 = Custom[© Views.Dependents](views=filterByBoolMask_2.out)
isOnSheet_2 = archilab.Revit.Views.Views.IsOnSheet(view=views_dependents_2.dependentViews)
anyTrue = Custom[Booleans.AnyTrue](seq=isOnSheet_2, lacing=Longest)  # package Clockwork for Dynamo 2.x; Returns true if any item in a list of booleans is true.
filterByBoolMask_3 = List.FilterByBoolMask(list=filterByBoolMask_2.out, mask=anyTrue)

# group: Get All Independent Unplaced Views
isOnSheet_3 = archilab.Revit.Views.Views.IsOnSheet(view=filterByBoolMask.out)
filterByBoolMask_4 = List.FilterByBoolMask(list=filterByBoolMask.out, mask=isOnSheet_3)

# group: Group By View Type
list_create = List.Create(item0=filterByBoolMask_3.out, item1=filterByBoolMask_4.out)
flatten = List.Flatten(list=list_create)
type = Custom[View.Type](view=flatten)  # package Clockwork for Dynamo 2.x; Returns the type of a given view
groupByKey = List.GroupByKey(list=flatten, keys=type)

# group: Main UI Window
code_block = CodeBlock { "What should be deleted?"; }
file_path = Filename("..\..\ShareFolder\icon.png")
code_block_2 = CodeBlock { "Delete Views"; "https://github.com/CrossArchitecture"; "Cancel"; 500; }
code_block_3 = CodeBlock { "List of Unplaced Views"; }
addItemToFront = List.AddItemToFront(item=groupByKey.unique_keys@L1, list=groupByKey.groups@L2)
boolean = BoolSelector(true)
code_block_4 = CodeBlock { 350; }
treeview_input = Custom[TreeView input](InputName=code_block_3, Data=addItemToFront, FirstItemIsTitle=boolean, Height=code_block_4)  # package Data-Shapes; Create a TreeView input for UI.MultipleInputForm ++ . Check out www.data-shapes.net for more infos and tips!
boolean_2 = BoolSelector(true)
multipleinputform = Custom[MultipleInputForm ++](Description_optional=code_block, Logo_optional=file_path, ButtonText_optional=code_block_2.out0, Inputs=treeview_input, Toggle=boolean_2, LinkToHelp_optional=code_block_2.out1, CancelButtonText_optional=code_block_2.out2, Width_optional=code_block_2.out3)  # package Data-Shapes; Create a form with multiple inputs. see www.data-shapes.net for tutorials and infos!
delete = archilab.Revit.Elements.Elements.Delete(element=multipleinputform.User_Inputs)
