# Dynamo graph script.dyn (Dynamo 2.6.1.8786)
# packages: Clockwork for Dynamo 2.x 2.3.0, Cross-Tools 0.0.1, Data-Shapes 2022.2.105, Crumple 2022.5.27, Genius Loci 2023.2.21, SteamNodes 1.2.4

categories = Categories("OST_Rooms")
all_elements_of_category = ElementsOfCategory(Category=categories)
code_block = CodeBlock { "Assign doors and windows to their rooms!"; }
code_block_2 = CodeBlock { "Next"; "Cancel"; 600; }
code_block_3 = CodeBlock { "Select Phase!"; }
collect_phases = Custom[© Collect.Phases]()  # package Crumple; Returns all phases in a document.
lastItem = List.LastItem(list=collect_phases.names)
indexOf = List.IndexOf(list=collect_phases.names, element=lastItem)
dropdown_data = Custom[DropDown Data](Keys=collect_phases.names, Values=collect_phases.names, DefaultValueIndex=indexOf)  # package Data-Shapes; Create data for DropDown input in UI.MultiInputForm ++ . Check out www.data-shapes.net for more infos.
inputgroup_data = Custom[InputGroup Data](GroupTitle=code_block_3, Inputs=dropdown_data)  # package Data-Shapes; Creates a group of inputs for UI.MultipleInputForm ++ . Check out www.data-shapes.net for more infos !
code_block_4 = CodeBlock { "Select Parameter"; }
code_block_5 = CodeBlock { "Door Count"; }
get_shared_parameter = Custom[Get Shared Parameter]()  # package Genius Loci; Get the parameters names, parameters groups, parameters types and assigned categories of the active shared parameter file.
flatten = List.Flatten(list=get_shared_parameter.ParameterName)
uniqueItems = List.UniqueItems(list=flatten)
code_block_6 = CodeBlock { "CXS DoorCount"; }
indexOf_2 = List.IndexOf(list=uniqueItems, element=code_block_6)
listview_data = Custom[Listview Data](InputName=code_block_5, Keys=uniqueItems, Values=uniqueItems, DefaultValueIndices_optionnal=indexOf_2)  # package Data-Shapes; Create data for ListView input in UI.MultiInputForm ++ . Check out www.data-shapes.net for more infos.
code_block_7 = CodeBlock { "Window Count"; }
get_shared_parameter_2 = Custom[Get Shared Parameter]()
flatten_2 = List.Flatten(list=get_shared_parameter_2.ParameterName)
uniqueItems_2 = List.UniqueItems(list=flatten_2)
code_block_8 = CodeBlock { "CXS WindowCount"; }
indexOf_3 = List.IndexOf(list=uniqueItems_2, element=code_block_8)
listview_data_2 = Custom[Listview Data](InputName=code_block_7, Keys=uniqueItems_2, Values=uniqueItems_2, DefaultValueIndices_optionnal=indexOf_3)
list_create = List.Create(item0=listview_data, item1=listview_data_2)
inputgroup_data_2 = Custom[InputGroup Data](GroupTitle=code_block_4, Inputs=list_create)
list_create_2 = List.Create(item0=inputgroup_data, item1=inputgroup_data_2)
boolean = BoolSelector(true)
crossUI = Custom[CrossUI](Description=code_block, ButtonText=code_block_2.out0, Inputs=list_create_2, Toggle=boolean, CancelButtonText=code_block_2.out1, Width=code_block_2.out2)  # package Cross-Tools; This is a predefined UI based on Data-Shapes
code_block_9 = CodeBlock(x=crossUI.User_Inputs) { x[0]; x[1]; x[2]; }
firstItem = List.FirstItem(list=code_block_9.out2)
getPhaseByName = Custom[Tool.GetPhaseByName](code_block_9.out0)  # package SteamNodes; Get Document Phases by String
windows = Custom[Room.Windows](room=all_elements_of_category, phase=getPhaseByName.Phase)  # package Clockwork for Dynamo 2.x; Retrieves all windows that are associated with a room (hosted in walls and roofs).
count = List.Count(list=windows@L2)
setParameterByName = Element.SetParameterByName(element=all_elements_of_category, parameterName=firstItem, value=count)
firstItem_2 = List.FirstItem(list=code_block_9.out1)
doors = Custom[Room.Doors](room=all_elements_of_category, phase=getPhaseByName.Phase)  # package Clockwork for Dynamo 2.x; Retrieves all doors that are associated with a room (hosted in walls and roofs).
count_2 = List.Count(list=doors@L2)
setParameterByName_2 = Element.SetParameterByName(element=all_elements_of_category, parameterName=firstItem_2, value=count_2)
