# Dynamo graph script.dyn (Dynamo 2.6.1.8786)
# packages: Clockwork for Dynamo 2.x 2.6.0, DynamoMEP 1.0.3, Data-Shapes 2022.2.105, Genius Loci 2023.2.21

# group: All placed rooms and divided in qm l1< 4qm <l2
rooms_by_status = RoomsByStatus()
area = Room.Area(room=rooms_by_status.PlacedRooms)
code_block = CodeBlock { 4; }
le = area <= code_block
filterByBoolMask = List.FilterByBoolMask(list=rooms_by_status.PlacedRooms, mask=le)

code_block_2 = CodeBlock { 0.2; 1; 0.5; }

# group: UI
code_block_3 = CodeBlock { "Which heights should be calculated?"; }
file_path = Filename("..\..\ShareFolder\icon.png")
code_block_4 = CodeBlock { "Next"; "Cancel"; }
code_block_5 = CodeBlock { "Finish Room Height"; "Raw Room Height"; }
list_create = List.Create(item0=code_block_5.out0, item1=code_block_5.out1)
listview_data = Custom[Listview Data](Keys=list_create, Values=list_create)  # package Data-Shapes; Create data for ListView input in UI.MultiInputForm ++ . Check out www.data-shapes.net for more infos.
code_block_6 = CodeBlock { "FYI!"; }
code_block_7 = CodeBlock { "OK"; "Cancel"; }
code_block_8 = CodeBlock()
# ---------- code_block_8.designscript (12 lines) ----------
"For the following application you will need some things:\n
1. 3D View with the name: Finish Room Height\n
        - A view just with rooms and finished geometry\n
2. 3D View with the name: Raw Room Height\n
        - A view just with rooms and raw geometry\n
3. Room Parameter:\n
        - CXS Lichte_Raumhoehe_min\n
        - CXS Lichte_Raumhoehe_max\n
        - CXS Lichte_Raumhoehe_avg\n
        - CXS Roh_Raumhoehe_min\n
        - CXS Roh_Raumhoehe_max\n
        - CXS Roh_Raumhoehe_avg\n";
# ----------------------------------------
textnote_data = Custom[TextNote Data](TextNote=code_block_8)  # package Data-Shapes; Create Data for TextNote input in UI.MultipleInputForm ++ . Check out www.data-shapes.net for more informations
boolean = BoolSelector(true)
code_block_9 = CodeBlock { "https://github.com/CrossArchitecture"; }
code_block_10 = CodeBlock { 600; }
multipleinputform = Custom[MultipleInputForm ++](Description_optional=code_block_6, Logo_optional=file_path, ButtonText_optional=code_block_7.out0, Inputs=textnote_data, Toggle=boolean, LinkToHelp_optional=code_block_9, CancelButtonText_optional=code_block_7.out1, Width_optional=code_block_10)  # package Data-Shapes; Create a form with multiple inputs. see www.data-shapes.net for tutorials and infos!
passthrough = Custom[Passthrough](passThrough=listview_data, waitFor=multipleinputform.Was_Run)  # package Clockwork for Dynamo 2.x; Forces a sequential order of execution. The node wired into the output of the Passthrough node will be executed *after* the node wired into the waitFor input (e.g. important for some Revit operations). The value of the passThrough input will be passed on to the node wired into the output port of the Passthrough node.
multipleinputform_2 = Custom[MultipleInputForm ++](Description_optional=code_block_3, Logo_optional=file_path, ButtonText_optional=code_block_4.out0, Inputs=passthrough, Toggle=boolean, LinkToHelp_optional=code_block_9, CancelButtonText_optional=code_block_4.out1, Width_optional=code_block_10)
string_from_object = FromObject(obj=multipleinputform_2.User_Inputs)

# group: Create Grid and compute the raybounce
grid = DynamoMEP.Room.Grid(room=filterByBoolMask.in, step=code_block_2.out0)
grid_2 = DynamoMEP.Room.Grid(room=filterByBoolMask.out, step=code_block_2.out1)
join = List.Join(list0=grid, list1=grid_2)
isEmpty = List.IsEmpty(list=join@@L2)
filterByBoolMask_2 = List.FilterByBoolMask(list=join@@L3, mask=isEmpty@L2)
flatten = List.Flatten(list=filterByBoolMask_2.out@L2)
watch = Watch(flatten)
ZAxis = Vector.ZAxis()
translate = Geometry.Translate(geometry=watch, direction=ZAxis, distance=code_block_2.out2)
code_block_11 = CodeBlock { 2; }
code_block_12 = CodeBlock { true; }
view_byname = Custom[View ByName](ViewName=string_from_object@L2, DoesContain=code_block_12)  # package Genius Loci; Collect views by given name in the active or given document. Based on a Christian Gartland's script.
byOriginDirection = Revit.References.RayBounce.ByOriginDirection(origin=translate, direction=ZAxis, maxBounces=code_block_11, view=view_byname@L1)
watch_2 = Watch(byOriginDirection.points)
join_2 = List.Join(list0=filterByBoolMask.in, list1=filterByBoolMask.out)
filterByBoolMask_3 = List.FilterByBoolMask(list=join_2, mask=isEmpty)
watch_3 = Watch(filterByBoolMask_3.out)

# group: Parameter
code_block_13 = CodeBlock { "CXS Lichte_Raumhoehe_min"; "CXS Roh_Raumhoehe_min"; "CXS Lichte_Raumhoehe_max"; "CXS Roh_Raumhoehe_max"; }

# group: Calculate the distance between the raybounce points
restOfItems = List.RestOfItems(list=watch_2@@L2)
watch_4 = Watch(restOfItems)
code_block_14 = CodeBlock { 1; -1; }
takeItems = List.TakeItems(list=watch_4@@L2, amount=code_block_14.out0)
takeItems_2 = List.TakeItems(list=watch_4@@L2, amount=code_block_14.out1)
distanceTo = Geometry.DistanceTo(geometry=takeItems@@L2, other=takeItems_2@L2)
code_block_15 = CodeBlock { 4; }
round = Math.Round(number=distanceTo@@L2, digits=code_block_15)
flatten_2 = List.Flatten(list=round@@L3)
eq = string_from_object@L1 == code_block_5.out0
if_ = If(test=eq, true=code_block_13.out0, false=code_block_13.out1)
uniqueItems = List.UniqueItems(list=flatten_2@L2)
code_block_16 = CodeBlock { 1; }
le_2 = uniqueItems <= code_block_16
filterByBoolMask_4 = List.FilterByBoolMask(list=uniqueItems, mask=le_2, lacing=Longest)
watch_5 = Watch(filterByBoolMask_4.out)
minimumItem = List.MinimumItem(list=watch_5@@L2)
setParameterByName = Element.SetParameterByName(element=watch_3, parameterName=if_@L1, value=minimumItem)
if_2 = If(test=eq, true=code_block_13.out2, false=code_block_13.out3)
maximumItem = List.MaximumItem(list=watch_5)
setParameterByName_2 = Element.SetParameterByName(element=watch_3, parameterName=if_2@L1, value=maximumItem)

countOccurences = Custom[List.CountOccurences](seq=flatten_2)  # package Clockwork for Dynamo 2.x; Counts the number of occurences of each unique element in a given list
watch_6 = Watch(countOccurences.uniqueElements)
watch_7 = Watch(countOccurences.count)
average = Math.Average(numbers=watch_7)

# group: UI
code_block_17 = CodeBlock { "FYI!"; }
file_path_2 = Filename("..\..\ShareFolder\icon.png")
code_block_18 = CodeBlock { "OK"; "Cancel"; }
count = List.Count(list=watch_3)
isNull = Object.IsNull(obj=setParameterByName_2@L1, lacing=Longest)
filterByBoolMask_5 = List.FilterByBoolMask(list=watch_3, mask=isNull)
count_2 = List.Count(list=filterByBoolMask_5.out)
count_3 = List.Count(list=filterByBoolMask_5.in)
code_block_19 = CodeBlock(x=count, y=count_2, z=count_3)
# ---------- code_block_19.designscript (6 lines) ----------
x;
y;
z;
"A total of " + x + " rooms were found in the project.\n" +
"The parameters were successfully assigned to " + y + " rooms.\n"
+ z +" rooms, however, showed any problems during the process and need a manual investigation!";
# ----------------------------------------
watch_8 = Watch(code_block_19.out3)
passthrough_2 = Custom[Passthrough](passThrough=watch_8, waitFor=filterByBoolMask_5.in)
textnote_data_2 = Custom[TextNote Data](TextNote=passthrough_2)
code_block_20 = CodeBlock { true; }
listview_data_2 = Custom[Listview Data](Keys=filterByBoolMask_5.in, Values=filterByBoolMask_5.in, HilightInView_optionnal=code_block_20, DisplayModeOnly_optionnal=code_block_20)
list_create_2 = List.Create(item0=textnote_data_2, item1=listview_data_2)
boolean_2 = BoolSelector(true)
code_block_21 = CodeBlock { "https://github.com/CrossArchitecture"; }
code_block_22 = CodeBlock { 600; }
multipleinputform_3 = Custom[MultipleInputForm ++](Description_optional=code_block_17, Logo_optional=file_path_2, ButtonText_optional=code_block_18.out0, Inputs=list_create_2, Toggle=boolean_2, LinkToHelp_optional=code_block_21, CancelButtonText_optional=code_block_18.out1, Width_optional=code_block_22)
