# Dynamo graph script.dyn (Dynamo 2.6.1.8786)
# packages: Rhythm 2020.9.8, Data-Shapes 2022.2.105, Clockwork for Dynamo 2.x 2.6.0

code_block = CodeBlock { "Curtain Panels"; }
byName = Category.ByName(name=code_block)
all_elements_of_category = ElementsOfCategory(Category=byName)
name = Element.Name(element=all_elements_of_category)
uniqueItems = List.UniqueItems(list=name)

# group: Link or Input Search Criteria
contains = CodeBlock { "Normal"; "Triangle"; "Insulation"; "Swing"; "glass"; "blind"; "solo"; "Glazed"; }

# group: UI
code_block_2 = CodeBlock { "Which panels should be isolated?"; }
file_path = Filename("..\..\ShareFolder\icon.png")
code_block_3 = CodeBlock { "Next"; "Cancel"; }
listview_data = Custom[Listview Data](Keys=uniqueItems, Values=uniqueItems)  # package Data-Shapes; Create data for ListView input in UI.MultiInputForm ++ . Check out www.data-shapes.net for more infos.
boolean = BoolSelector(true)
code_block_4 = CodeBlock { "https://github.com/CrossArchitecture"; }
code_block_5 = CodeBlock { 600; }
multipleinputform = Custom[MultipleInputForm ++](Description_optional=code_block_2, Logo_optional=file_path, ButtonText_optional=code_block_3.out0, Inputs=listview_data, Toggle=boolean, LinkToHelp_optional=code_block_4, CancelButtonText_optional=code_block_3.out1, Width_optional=code_block_5)  # package Data-Shapes; Create a form with multiple inputs. see www.data-shapes.net for tutorials and infos!
list_create = List.Create(item0=contains.out0, item1=contains.out1, item2=contains.out2, item3=contains.out3, item4=contains.out4, item5=contains.out5, item6=contains.out6, item7=contains.out7)

passthrough = Custom[Passthrough](passThrough=name, waitFor=multipleinputform.Was_Run)  # package Clockwork for Dynamo 2.x; Forces a sequential order of execution. The node wired into the output of the Passthrough node will be executed *after* the node wired into the waitFor input (e.g. important for some Revit operations). The value of the passThrough input will be passed on to the node wired into the output port of the Passthrough node.
contains_2 = String.Contains(str=passthrough, searchFor=multipleinputform.User_Inputs@L1)
filterByBoolMask = List.FilterByBoolMask(list=all_elements_of_category, mask=contains_2@L2)
isolateInView = Rhythm.Revit.Elements.CurtainPanels.IsolateInView(curtainPanels=filterByBoolMask.in)
