# Dynamo graph script.dyn (Dynamo 2.6.1.8786)
# packages: Crumple 2022.5.27, Genius Loci 2023.2.21, Clockwork for Dynamo 1.x 1.31.1, MEPover 2022.10.30, Cross-Tools 0.0.1, Data-Shapes 2022.2.105

all_categories_in_document = Custom[All categories in document]()  # package MEPover; Retrieves all categories from the current document and splits them up in Model, Annotation, Analytic and Internal Categories
boolean = BoolSelector(true)
string = StringInput("Place View(s) on a Sheet")
string_2 = StringInput("Next")
string_3 = StringInput("Customise your Sheet")
code_block = CodeBlock { "Title Blocks"; }
byName = Category.ByName(name=code_block)
all_family_types_of_category = Custom[All Family Types Of Category](category=byName)  # package Clockwork for Dynamo 1.x; Gets all family types/symbols of a given category in the model (does *not *work for system families)
string_from_object = FromObject(obj=all_family_types_of_category)
code_block_2 = CodeBlock { 0; 13; }
remove = String.Remove(str=string_from_object, startIndex=code_block_2.out0, count=code_block_2.out1)
listview_data = Custom[Listview Data](Keys=remove, Values=all_family_types_of_category)  # package Data-Shapes; Create data for ListView input in UI.MultiInputForm ++ . Check out www.data-shapes.net for more infos.
string_4 = StringInput("Sheet Number")
textbox_data = Custom[TextBox Data](InputName=string_4, DefaultText=string_4)  # package Data-Shapes; Create Data for TextBox input in UI.MultipleInputForm ++ . Check out www.data-shapes.net for more informations
string_5 = StringInput("Sheet Name")
textbox_data_2 = Custom[TextBox Data](InputName=string_5, DefaultText=string_5)
list_create = List.Create(item0=listview_data, item1=textbox_data, item2=textbox_data_2)
inputgroup_data = Custom[InputGroup Data](GroupTitle=string_3, Inputs=list_create)  # package Data-Shapes; Creates a group of inputs for UI.MultipleInputForm ++ . Check out www.data-shapes.net for more infos !
string_6 = StringInput("Select your View(s)")
collect_views = Custom[© Collect.Views]()  # package Crumple; Returns all views in a document. Excludes system views, templates, legends and schedule instances.
collector_of_placedviews = Custom[Collector of PlacedViews]()  # package Genius Loci; This node will collect all views placed on sheets in the active or given document.
watch = Watch(collector_of_placedviews.All_Placed_Views)
setDifference = List.SetDifference(list1=collect_views, list2=watch)
listview_data_2 = Custom[Listview Data](Keys=setDifference, Values=setDifference)
inputgroup_data_2 = Custom[InputGroup Data](GroupTitle=string_6, Inputs=listview_data_2)
string_7 = StringInput("Select Location")
code_block_3 = CodeBlock { "X-Axis"; -3; 0; 0; 0.01; }
slider = Custom[Slider](InputName=code_block_3.out0, Minimum=code_block_3.out1, Maximum=code_block_3.out2, Default_Value=code_block_3.out3, Step=code_block_3.out4)  # package Data-Shapes; Creates slider input for UI.MultipleInputForm ++ . Set the step to decimal value if you want a double slider, or to a integer value if you want an integer slider.
code_block_4 = CodeBlock { "Y-Axis"; 0; 3; 0; 0.01; }
slider_2 = Custom[Slider](InputName=code_block_4.out0, Minimum=code_block_4.out1, Maximum=code_block_4.out2, Default_Value=code_block_4.out3, Step=code_block_4.out4)
list_create_2 = List.Create(item0=slider, item1=slider_2)
inputgroup_data_3 = Custom[InputGroup Data](GroupTitle=string_7, Inputs=list_create_2)
list_create_3 = List.Create(item0=inputgroup_data, item1=inputgroup_data_2, item2=inputgroup_data_3)
boolean_2 = BoolSelector(true)
string_8 = StringInput("Cancel")
crossUI = Custom[CrossUI](Description=string, ButtonText=string_2, Inputs=list_create_3, Toggle=boolean_2, CancelButtonText=string_8)  # package Cross-Tools; This is a predefined UI based on Data-Shapes
code_block_5 = CodeBlock(x=crossUI.User_Inputs) { x[0]; x[1]; x[2]; x[3]; x[4]; x[5]; }
watch_2 = Watch(code_block_5.out0)
watch_3 = Watch(code_block_5.out2)
watch_4 = Watch(code_block_5.out1)
sheets_create = Custom[© Sheets.Create](ttb_type=watch_2, names=watch_3, numbers=watch_4)  # package Crumple; Creates Revit sheets based on a list of names, numbers and a single Titleblock type.
passthrough = Custom[Passthrough](passThrough=sheets_create.sheets, waitFor=sheets_create.success)  # package Clockwork for Dynamo 1.x; Forces a sequential order of execution. The node wired into the output of the Passthrough node will be executed *after* the node wired into the waitFor input (e.g. important for some Revit operations). The value of the passThrough input will be passed on to the node wired into the output port of the Passthrough node.
flatten = List.Flatten(list=passthrough)
watch_5 = Watch(code_block_5.out3)
count = List.Count(list=watch_5)
chop = List.Chop(list=watch_5, lengths=count)
byCoordinates = Point.ByCoordinates(x=code_block_5.out4, y=code_block_5.out5)
list_create_4 = List.Create(item0=byCoordinates)
ofRepeatedItem = List.OfRepeatedItem(item=list_create_4, amount=count)
flatten_2 = List.Flatten(list=ofRepeatedItem)
chop_2 = List.Chop(list=flatten_2, lengths=count)
placeViewsOnSheets = Custom[PlaceViewsOnSheets](Run=boolean, sheet=flatten, views=chop, locations=chop_2)  # package Cross-Tools
watch_6 = Watch(placeViewsOnSheets.sheet)
watch_7 = Watch(placeViewsOnSheets.viewport)
