# Dynamo graph script.dyn (Dynamo 2.6.1.8786)
# packages: Clockwork for Dynamo 2.x 2.4.0

all_elements_in_active_view = ElementsInView()
activeViewFromCurrentDocument = Custom[Document.ActiveViewFromCurrentDocument]()  # package Clockwork for Dynamo 2.x; Gets the active view of the current document
resetElementOverrides = Custom[View.ResetElementOverrides](element=all_elements_in_active_view, view=activeViewFromCurrentDocument)  # package Clockwork for Dynamo 2.x; Resets all overrides for an element in a given view
